# Dynamo graph Insert Values.dyn (Dynamo 1.3.1.1736)

# group: Set Category
categories = Categories("DuctCurves")

# group: Get all elements and their parameters
all_elements_of_category = ElementsOfCategory(categories)
parameters = Element.Parameters(all_elements_of_category)

# group: Insert Element Id's to beginning of lists
id = Element.Id(all_elements_of_category)
python_script = Python(IN[0]=id)
# ---------- python_script.python (11 lines) ----------
import clr
clr.AddReference('ProtoGeometry')
from Autodesk.DesignScript.Geometry import *
#The inputs to this node will be stored as a list in the IN variables.
listIn = IN[0]

for index, i in enumerate(listIn):
	listIn[index] = "Element Id : " + str(i)

#Assign your output to the OUT variable.
OUT = listIn
# ----------------------------------------
python_script_2 = Python(IN[0]=parameters, IN[1]=python_script)
# ---------- python_script_2.python (12 lines) ----------
import clr
clr.AddReference('ProtoGeometry')
from Autodesk.DesignScript.Geometry import *
#The inputs to this node will be stored as a list in the IN variables.
mainList = IN[0]
elementIds = IN[1]

for ele_a, ele_b in zip(mainList, elementIds):
    ele_a.insert(0, ele_b)

#Assign your output to the OUT variable.
OUT = mainList
# ----------------------------------------
watch = Watch(python_script_2)

file_path = Filename("..\DB\Mechanical.db")
boolean = BoolSelector(true)

# group: Create list of Element Ids with sublists of parameters
python_create_sublists = Python(IN[2]=python_script_2)  # unwired: IN[0], IN[1]
# ---------- python_create_sublists.python (14 lines) ----------
import clr
clr.AddReference('ProtoGeometry')
from Autodesk.DesignScript.Geometry import *
#The inputs to this node will be stored as a list in the IN variables.
#The inputs to this node will be stored as a list in the IN variables.
tableName = IN[0]
listOfFields = IN[1]
listOfValues = IN[2]

# Create dictionary items with first value as key
dictionary = {e[0].split(" : ")[1] : e[1:] for e in listOfValues}

#Assign your output to the OUT variable.
OUT = dictionary.items()
# ----------------------------------------
watch_2 = Watch(python_create_sublists)

# group: Create dictionary of parameters (all elements)
python_create_dictionary = Python(IN[0]=watch_2)
# ---------- python_create_dictionary.python (55 lines) ----------
import clr
clr.AddReference('ProtoGeometry')
from Autodesk.DesignScript.Geometry import *
#The inputs to this node will be stored as a list in the IN variables.
listIn = IN[0]

oneElement = listIn[0]
oneElementId = oneElement[0]
oneElementsParams = oneElement[1]

allElements = []


for index, i in enumerate(listIn):
	allElements.append(["Element Id : " + listIn[index][0]])
	
for index, i in enumerate(listIn):
	for pIndex, p in enumerate(listIn[index][1]):
		allElements[index].append(listIn[index][1][pIndex])
		
allValues = [[] for i in listIn]
		
for index, i in enumerate(allElements):
	for pIndex, i in enumerate(allElements[index]):
		#allValues[index].append(str(allElements[index][pIndex]).split(" : ", 1)[1])
		allValues[index].append(str(allElements[index][pIndex]).split(" : "))

#myDict = dict(str(item).split(" : ") for index, item in enumerate(allElements[index]))

#for index, i in enumerate(allElements):
#	myDict.append(dict(str(item).split(" : ") for item in allElements[index]))

#Create dictionary of parameters with key from param name
#myDic = dict(str(item).split(" : ") for item in oneElementsParams)

# Add Element Id to dictionary
#myDic['Element Id'] = oneElementId

OUT = allValues

# Output dictionary with Element Id as key
#elementDict = dict(zip(listIn[0][0:][0],listIn[0][0:][1]))
#OUT = elementDict.items()

# First element
#OUT = listIn[0][0]

# Drill down to first element Id
#OUT = listIn[0][0][0]

# Drill down to first list of parameters 
#OUT = listIn[0][0][1]

# Drill down to first parameter in first list of parameters
#OUT = listIn[0][1][0]
# ----------------------------------------
watch_3 = Watch(python_create_dictionary)

python_string_from_object = Python(IN[0]=categories)
# ---------- python_string_from_object.python (9 lines) ----------
import clr
clr.AddReference('ProtoGeometry')
from Autodesk.DesignScript.Geometry import *
#The inputs to this node will be stored as a list in the IN variables.
category = IN[0]


#Assign your output to the OUT variable.
OUT = '"' + str(category) + '"'
# ----------------------------------------
code_block = CodeBlock(tableName=python_string_from_object) { tableName; }

# group: Create SQL command
python_sql_command = Python(IN[0]=watch_3, IN[1]=code_block)
# ---------- python_sql_command.python (64 lines) ----------
import clr
clr.AddReference('ProtoGeometry')
from Autodesk.DesignScript.Geometry import *
#The inputs to this node will be stored as a list in the IN variables.
listIn = IN[0]
tableName = IN[1]

sqlCommand = "BEGIN TRANSACTION; \n"
questionMarks = ""
listOfColumns = []
columnNames = ""
columnValues = ""


for index1, i1 in enumerate(listIn):
	sqlCommand += "INSERT INTO " + tableName + " ("
	for index2, i2 in enumerate(listIn[index1]):
		sqlCommand += '"' + listIn[index1][index2][0] + '", '
	sqlCommand = sqlCommand[:-2]
	sqlCommand += ") \n VALUES ("
	for index2, i2 in enumerate(listIn[index1]):
		listIn[index1][index2][1] = listIn[index1][index2][1].replace("\"", " in")
		listIn[index1][index2][1] = listIn[index1][index2][1].replace("\'", " ft")
		listIn[index1][index2][1] = listIn[index1][index2][1].replace("ø", " Diam")
		sqlCommand += '"' + listIn[index1][index2][1] + '\", '
	sqlCommand = sqlCommand[:-2]
	sqlCommand += "); \n"
	
sqlCommand += "COMMIT;"
	
OUT = sqlCommand

	#sqlCommand += columnNames + "\n"
#	for pIndex, i in enumerate(listIn[listIndex]):
#		columnNames += listIn[listIndex][pIndex][0] + '"' + ', '
		
#for listIndex, i in enumerate(listIn):
#	for pIndex, i in enumerate(listIn[listIndex]):
#		for param, i in enumerate(listIn[listIndex][pIndex]):
#			listOfColumns.append('"' + listIn[listIndex][pIndex][0] + '"' + ', ')


#columnNames = columnNames[:-2]

#for listIndex, i in enumerate(listIn):
	# Catch and replace certain characters that break the string
#	listIn[listIndex][1] = listIn[listIndex][1].replace("\"", " in")
#	listIn[listIndex][1] = listIn[listIndex][1].replace("\'", " ft")
#	listIn[listIndex][1] = listIn[listIndex][1].replace("ø", " Diam")
	
	# Write to columnValues with values wrapped in quptes and separated by commas
#	columnValues += '"' + listIn[listIndex][1] + '"' + ', '
#columnValues = columnValues[:-2]

#for listIndex, i in enumerate(listIn):
#	questionMarks += '?, '
#questionMarks = questionMarks[:-2]

# Create a table in the db
#sqlCommand += "CREATE TABLE " + tableName + " (" + columnNames + ") \n"


#sqlCommand += "VALUES (" + questionMarks + "), " + columnValues
#sqlCommand += "VALUES (" + columnValues + ")"
# ----------------------------------------
watch_4 = Watch(python_sql_command)

SQLite_Command = Database.Command.SQLite_Command(file_path, boolean, watch_4)
